# Grasshopper definition Habeetat plot.gh (Grasshopper 1.0.7)

# ---- group: NEIGHBORHOOD POSITION
n2 = Slider(49, range=0..100)
n1 = Slider(20, range=0..100)
n4 = Slider(28, range=0..100)
n5 = Slider(31, range=0..100)
n3 = Slider(42, range=0..100)

# ----
n5_2 = Slider(43, range=0..100)
crv = Curve(<curve referenced from the Rhino model>)
boundary = BoundarySurfaces(Edges=crv)

# ---- group: NEIGBORHOOD SIZE
n4_2 = Slider(8, range=0..10)
n4_3 = Slider(8, range=0..10)
n1_m = Slider(60, range=0..100)
n2_2 = Slider(38, range=0..100)
n4_4 = Slider(7, range=0..10)

# ----
n4_5 = Slider(58, range=0..100)
popgeo = PopulateGeometry(Geometry=boundary, Count=Slider(100, range=0..100), Seed=Slider(19, range=0..100))
item = ListItem(List=popgeo, Index=[n1, n2, n3, n4, n5, n5_2], Wrap=True)

# ---- group: TOTAL HOUSE
n1_2 = Slider(5, range=0..10)
n2_3 = Slider(5, range=0..10)
n4_6 = Slider(5, range=0..10)
n5_3 = Slider(6, range=0..10)
n3_2 = Slider(7, range=0..10)

# ----
n5_4 = Slider(10, range=0..10)
cull_i = CullIndex(List=popgeo, Indices=item, Wrap=True)
python = GhPythonScript(x=item, y=[n1_m, n2_2, n4_3, n4_4, n4_2, n4_5])  # -> out, a; inputs x: Point3d
# ---------- python: Python ----------
__author__ = "LENOVO-PC"
__version__ = "2023.04.11"

import rhinoscriptsyntax as rs
import Rhino.Geometry as rg

# Define the inputs
point = rg.Point3d(x.X, x.Y, x.Z)
radius = y

# Create the circle
circle = rg.Circle(point, radius)

# Output the result
a = circle.ToNurbsCurve()
# ---------- end python ----------
panel = Panel("""N1
N2
N3
N4
N5""")
item_2 = ListItem(List=popgeo, Index=[cull_i, Slider(5, range=0..10)], Wrap=True)
tag = TextTag(Location=item, Text=panel)
offset = OffsetCurve(Curve=python.a, Distance=Slider(-2.5, range=-2.5..0), Corners=1)
divide = DivideCurve(Curve=python.a, Count=[n1_2, n2_3, n3_2, n4_6, n5_3, n5_4], Kinks=False)  # -> Points, Tangents, Parameters
boundary_2 = BoundarySurfaces(Edges=offset)
sdivide = DivideSurface(Surface=boundary_2, UCount=Slider(3, range=0..10), VCount=Slider(3, range=0..10))  # -> Points, Normals, Parameters
python_2 = GhPythonScript(
    x=divide.Points,
    y=[Slider(3, range=0..10), Slider(5, range=0..10), Slider(5, range=0..10), Slider(8, range=0..10)],
    z=[Slider(4, range=0..10), Slider(6, range=0..10), Slider(5, range=0..10), Slider(10, range=0..10)])  # -> out, a; inputs x: Point3d, y: Int32, z: Int32
# ---------- python_2: Python ----------
__author__ = "LENOVO-PC"
__version__ = "2023.04.11"

import Rhino.Geometry as rg

# Define the inputs
center = rg.Point3d(x.X, x.Y, x.Z)
width = y
height = z

# Create rectangle
plane = rg.Plane(center, rg.Vector3d.ZAxis)
rectangle = rg.Rectangle3d(plane, width, height)

# Move rectangle to align with center point
translation = rg.Transform.Translation(-width/2, -height/2, 0)
rectangle.Transform(translation)

# Output rectangle
a = rectangle
# ---------- end python_2 ----------
boundary_3 = BoundarySurfaces(Edges=python_2.a)
Z = UnitZ(Factor=1)
item_3 = ListItem(List=python_2.a, Index=Slider(4, range=0..4), Wrap=True)
panel_2 = Panel(item_3)
extr = Extrude(Base=boundary_3, Direction=Z)
