# Grasshopper definition Habeetat.gh (Grasshopper 1.0.7)
# plug-ins: Human, Pufferfish, MetaHopper, Human UI

# ----
# HABITAT TYPE
# CONDITION
# STRATEGY
value_list = ValueList({"BAREGROUND/PARK": 2, "VEGETATED GARDEN": 2, "RAIN GARDEN": 2, "OTHER GREEN ROOF": 2, "DEVELOPED LAND/SEALED SURFACE": 0, "BUILT LINEAR FEATURE": 0, "()": 0}, selected=["BAREGROUND/PARK", "OTHER GREEN ROOF", "DEVELOPED LAND/SEALED SURFACE"])
value_list_2 = ValueList({"LOCAL STRATEGY": 1,15, "ECOLOGICALY DESIRABLE BUT NOT LOCAL": 1,1, "NOT BOTH OF LOCAL AND ECOLOGICAL": 1, "()": 0}, selected="NOT BOTH OF LOCAL AND ECOLOGICAL")
value_list_3 = ValueList({"GOOD": 3, "MODERATE": 2, "POOR": 1, "()": 0}, selected="MODERATE")

# ----
# These features will give you options to frame the site
# and making cluster of neighborhood
value_list_4 = ValueList({"LINE OF TREES": 0, "NATIVE HEDGEROW": 0, "NATIVE HEDGEROW WITH TREES": 2, "SEALED SURFACE": 0, "SPECIES RICH HEDGEROW": 2, "SPECIES RICH HEDGEROW WITH TREES": 4, "()": 0}, selected="()")

# ---- group: Arrange Cluster Layout
number_slider = Slider(3, range=0..30)

# ----
# CONDITION
# STRATEGY
value_list_5 = ValueList({"GOOD": 3, "MODERATE": 2, "POOR": 1, "()": 0}, selected="()")
value_list_6 = ValueList({"LOCAL STRATEGY": 1,15, "ECOLOGICALY DESIRABLE BUT NOT LOCAL": 1,1, "NOT BOTH OF LOCAL AND ECOLOGICAL": 1, "()": 0}, selected="()")

# ----
# AREA
show = BooleanToggle(False)

value_list_7 = ValueList({"LOCAL STRATEGY": 1,15, "ECOLOGICALY DESIRABLE BUT NOT LOCAL": 1,1, "NOT BOTH OF LOCAL AND ECOLOGICAL": 1, "()": 0}, selected="LOCAL STRATEGY")
value_list_8 = ValueList({"GOOD": 3, "MODERATE": 2, "POOR": 1, "()": 0}, selected="MODERATE")
value_list_9 = ValueList({"LINE OF TREES": LOW, "NATIVE HEDGEROW": LOW, "NATIVE HEDGEROW WITH TREES": MEDIUM, "SEALED SURFACE": VERY LOW, "SPECIES RICH HEDGEROW": MEDIUM, "SPECIES RICH HEDGEROW WITH TREES": HIGH, "()": 0}, selected="NATIVE HEDGEROW WITH TREES")

value_list_10 = ValueList({"LOCAL STRATEGY": 1,15, "ECOLOGICALY DESIRABLE BUT NOT LOCAL": 1,1, "NOT BOTH OF LOCAL AND ECOLOGICAL": 1, "()": 0}, selected="LOCAL STRATEGY")
value_list_11 = ValueList({"GOOD": 3, "MODERATE": 2, "POOR": 1, "()": 0}, selected="MODERATE")
value_list_12 = ValueList({"BAREGROUND/PARK": 2, "VEGETATED GARDEN": 1.93, "RAIN GARDEN": 2, "DEVELOPED LAND/SEALED SURFACE": 0, "BUILT LINEAR FEATURE": 0, "()": 0}, selected="BAREGROUND/PARK")

value_list_13 = ValueList({"LOCAL STRATEGY": 1,15, "ECOLOGICALY DESIRABLE BUT NOT LOCAL": 1,1, "NOT BOTH OF LOCAL AND ECOLOGICAL": 1, "()": 0}, selected="ECOLOGICALY DESIRABLE BUT NOT LOCAL")
value_list_14 = ValueList({"BAREGROUND/PARK": 2, "VEGETATED GARDEN": 1.93, "RAIN GARDEN": 2, "DEVELOPED LAND/SEALED SURFACE": 0, "BUILT LINEAR FEATURE": 0, "()": 0}, selected="VEGETATED GARDEN")

# ---- group: Arrange Your share Built Area with Nature
# These features will give you plotting options between buildings,
# and diferrent type of habitats around them).
# Click true to show the design. Modify the features on the left side
# LAND USE
number_slider_2 = Slider(2, range=0..15)

# ----
value_list_15 = ValueList({"RØN (Sorbus Hybrida": "RØN (Sorbus Hybrida)", "RUBINIA (Robinia pseudoacacia)", "PLATAN (Plantear)", "ELM (Ulmus glabra)", "BETULA PENDULA", "KIRSBÆR (Ceresia)"}, selected=["RUBINIA (Robinia pseudoacacia)", "KIRSBÆR (Ceresia)"])
canopy_wide = Slider(4, range=0..10)
value_list_16 = ValueList({"N/A CONDITION-BASED": 1, "()": 0}, selected="N/A CONDITION-BASED")

# ---- group: Slide to provide shared garden
number_slider_3 = Slider(2, range=0..10)

# ---- group: Arrange how much shared garden
number_slider_4 = Slider(2, range=0..10)

# ----
# CONDITION
# STRATEGY
value_list_17 = ValueList({"GOOD": 3, "MODERATE": 2, "POOR": 1, "()": 0}, selected="MODERATE")
value_list_18 = ValueList({"LOCAL STRATEGY": 1,15, "ECOLOGICALY DESIRABLE BUT NOT LOCAL": 1,1, "NOT BOTH OF LOCAL AND ECOLOGICAL": 1, "()": 0}, selected="ECOLOGICALY DESIRABLE BUT NOT LOCAL")

# ----
# SHOW TREES LANDSCAPE
show_2 = BooleanToggle(False)

python = GhPythonScript(x=show_2)  # -> out, a
# ---------- python: Python ----------
__author__ = "LENOVO-PC"
__version__ = "2023.05.22"

import rhinoscriptsyntax as rs
if x == True:
    a = 4

print a
# ---------- end python ----------
# This feature allows you to put your preferences building height (m),
#  type of green roof, amount of trees on green roof,
# green wall. Click True to show the 3D. Change the features on the left side
# 3
show_3 = BooleanToggle(True)

# ----
# BUILDING TYPE 2
# STRATEGY
width = Slider(2, range=0..10)
how_many = Slider(2, range=0..10)
distance = Slider(10, range=0..10)
value_list_19 = ValueList({"LOCAL STRATEGY": 1,15, "ECOLOGICALY DESIRABLE BUT NOT LOCAL": 1,1, "NOT BOTH OF LOCAL AND ECOLOGICAL": 1, "()": 0}, selected="()")
toggle = BooleanToggle(False)

# ----
# USE GREEN ROOF?
number_slider_5 = Slider(3, range=0..10)

# ----
# ADDITION BALCONY GARDEN
# BUILDING TYPE 1
# STRATEGY
width_2 = Slider(2, range=0..10)
how_many_2 = Slider(6, range=0..20)
distance_2 = Slider(8, range=0..10)
value_list_20 = ValueList({"LOCAL STRATEGY": 1,15, "ECOLOGICALY DESIRABLE BUT NOT LOCAL": 1,1, "NOT BOTH OF LOCAL AND ECOLOGICAL": 1, "()": 0}, selected="()")
toggle_2 = BooleanToggle(False)

# ----
# HABITAT
# CONDITION
# STRATEGY
value_list_21 = ValueList({"INTENSIVE GREEN ROOF": 2, "BIODIVERSE GREEN ROOF": 4, "OTHER GREEN ROOF": 2, "()": 0}, selected="INTENSIVE GREEN ROOF")
value_list_22 = ValueList({"GOOD": 3, "MODERATE": 2, "POOR": 1, "()": 0}, selected="MODERATE")
value_list_23 = ValueList({"LOCAL STRATEGY": 1,15, "ECOLOGICALY DESIRABLE BUT NOT LOCAL": 1,1, "NOT BOTH OF LOCAL AND ECOLOGICAL": 1, "()": 0}, selected="LOCAL STRATEGY")

# ----
# HABITAT
# CONDITION
# STRATEGY
value_list_24 = ValueList({"Ground-based GW": 2, "Face-bound GW": 2}, selected="Ground-based GW")
value_list_25 = ValueList({"GOOD", "MODERATE", "POOR", "()"}, selected="MODERATE")
value_list_26 = ValueList({"LOCAL STRATEGY": 1,15, "ECOLOGICALY DESIRABLE BUT NOT LOCAL": 1,1, "NOT BOTH OF LOCAL AND ECOLOGICAL": 1, "()": 0}, selected="ECOLOGICALY DESIRABLE BUT NOT LOCAL")

# ----
# HABITAT
# CONDITION
# STRATEGY
value_list_27 = ValueList({"INTENSIVE GREEN ROOF": 2, "BIODIVERSE GREEN ROOF": 4, "OTHER GREEN ROOF": 2, "()": 0}, selected="BIODIVERSE GREEN ROOF")
value_list_28 = ValueList({"GOOD": 3, "MODERATE": 2, "POOR": 1, "()": 0}, selected="GOOD")
value_list_29 = ValueList({"LOCAL STRATEGY": 1,15, "ECOLOGICALY DESIRABLE BUT NOT LOCAL": 1,1, "NOT BOTH OF LOCAL AND ECOLOGICAL": 1, "()": 0}, selected="LOCAL STRATEGY")

# ----
# GREEN WALL
# PLANTS
value_list_30 = ValueList({"Ivy (Hedera Helix)", "Vildvin(Parthenocissus)"}, selected="Ivy (Hedera Helix)")

# ----
# ARRANGE
# GREEN WALL
building_type_1 = Slider(1, range=0..100)
building_type_2 = Slider(4, range=0..100)

# ----
# GREEN WALL
show_4 = BooleanToggle(False)

# ----
# TREE GREEN ROOF
show_5 = BooleanToggle(False)

# ----
# 4
# SHOW 3D BUILDING
show_6 = BooleanToggle(True)

# ----
# YES
# 
# NO
toggle_3 = BooleanToggle(False)

# ----
# 5
# ASSESSMENT
toggle_4 = BooleanToggle(True)

# ----
# SHOW DETAILS
# HABITAT UNIT
# CREATED
# HABITAT AREA
# CREATED
click = BooleanToggle(False)

habitat = Panel("""TREES
GREEN FEATURES1
GREEN FEATURES2
GARDEN""")

# ----
# SYMBIOSIS
# BIOPHILIA & SAFE MIGRATORY
show_7 = BooleanToggle(False)

# ----
# ECOLOGICAL CONNECTIVITY
show_8 = BooleanToggle(False)

# ----
# SOCIAL CONNECTIVITY
show_9 = BooleanToggle(False)

# ----
# GARDEN PLANTS
value_list_31 = ValueList({"Kornvalmue (Papaver Rhoeas)", "Almindelig merian(Origanum vulgare)", "Origanum vulgare (white flowered)", "Echium vulgare", "Centaurea Scabiosa", "Echium vulgare \"blue bedder": "Echium vulgare "blue bedder"", "Anthemis tinctoria", "Thymus vulgare", "Silene dioica", "Knautia arvensis", "Campanula persicifolia", "valerian officinalis", "Stachys sylvatica", "Vaccinium corymbosum L", "Solanum lycopersicum var. Cerasiforme", "Grass", "Autumn crocus (Colchicum autumnale)"}, selected=["Kornvalmue (Papaver Rhoeas)", "Centaurea Scabiosa", "Anthemis tinctoria", "Silene dioica", "Grass"])
python_2 = GhPythonScript(Plants_choice=value_list_31)  # -> flatten(Pollinators_invited), flatten(Effects_human)
# ---------- python_2: Python ----------
import rhinoscriptsyntax as rs
if Plants_choice == "Kornvalmue (Papaver Rhoeas)":
    Pollinators_invited = "Honey bee", "Bumble bee", "Solitary bee", "Lepidoptera", "Hoverfly", "Song Birds"
elif Plants_choice == "Echium vulgare":
    Pollinators_invited = "Honey bee", "Bumble bee", "Solitary bee", "Lepidoptera", "Hoverfly"
    Effects_human = "Skin irritation", "Toxic food"
elif Plants_choice == "Almindelig merian(Origanum vulgare)":
    Pollinators_invited = "Honey bee", "Bumble bee", "Solitary bee", "Lepidoptera", "Hoverfly"
elif Plants_choice == "Centaurea Scabiosa":
    Pollinators_invited = "Honey bee", "Bumble bee", "Solitary bee", "Lepidoptera", "Hoverfly"
    Effects_human = "Food"
elif Plants_choice == "Origanum vulgare (white flowered)":
    Pollinators_invited = "Honey bee", "Bumble bee", "Solitary bee", "Lepidoptera", "Hoverfly"
elif Plants_choice == "Anthemis tinctoria":
    Pollinators_invited = "Solitary bee", "Lepidoptera", "Hoverfly", "Song Birds"
elif Plants_choice == "Thymus vulgare":
    Pollinators_invited = "Solitary bee", "Hoverfly"
    Effects_human = "Food"
elif Plants_choice == "Grass":
    Pollinators_invited = "Honey bee", "Solitary bee", "Hoverfly", "Song Birds"
    Effects_human = "Allergies", "Recreation"
elif Plants_choice == "Autumn crocus (Colchicum autumnale)":
    Pollinators_invited = "Honey bee", "Bumble bee", "Solitary bee", "Hoverfly"
    Effects_human = "Toxic food"
elif Plants_choice == "Vaccinium corymbosum L":
    Pollinators_invited = "Honey bee", "Bumble bee", "Solitary bee", "Hoverfly"
    Effects_human = "Food"


print Pollinators_invited
print Effects_human
# ---------- end python_2 ----------

addition = Addition(A=value_list_20, B=value_list_19)
panel = Panel("YEAR TARGET")
panel_2 = Panel("""ENVIRONMENTAL
EFFECT""")
panel_3 = Panel("""ENVIRONMENTAL 
EFFECT""")
panel_4 = Panel("""POLLINATORS
INVITED """)
python_3 = GhPythonScript(x=value_list)  # -> out, a, b
# ---------- python_3: Python ----------
__author__ = "LENOVO-PC"
__version__ = "2023.05.19"

import rhinoscriptsyntax as rs
if x == 2:
    a = "Storm water service"
    b = "Recreation"

print a
print b
# ---------- end python_3 ----------
python_4 = GhPythonScript(x=[value_list_28, value_list_22, value_list_8, value_list_5, value_list_11, value_list_16])  # -> out, a
# ---------- python_4: Python ----------
__author__ = "LENOVO-PC"
__version__ = "2023.05.16"

import rhinoscriptsyntax as rs
if x == 3:
    a = 5
if x == 2:
    a = 3
if x == 1:
    a = 1

print a
# ---------- end python_4 ----------
python_5 = GhPythonScript(x=[value_list_27, value_list_21, value_list_14, value_list_22])  # -> out, a
# ---------- python_5: Python ----------
__author__ = "LENOVO-PC"
__version__ = "2023.05.16"

import rhinoscriptsyntax as rs
if x > 1:
    a = "Recreation"

print a
# ---------- end python_5 ----------
function = Panel(python_5.a)
ma = MassAddition(Input=value_list)  # -> Result, PartialResults

area = Area()  # -> flatten(Area), Centroid
ma_2 = MassAddition(Input=area.Area)  # -> Result, PartialResults

python_6 = GhPythonScript(x=[value_list_30, value_list_15])  # -> flatten(Pollinators_Invited), flatten(Environmental_benefits), flatten(Effects_human)
# ---------- python_6: Python ----------
import rhinoscriptsyntax as rs
if x == "Ivy (Hedera Helix)":
    Environmental_benefits = "Wind breaker", "Storm water service"
    Pollinators_Invited = "Honey bee", "Lepidoptera", "Song Birds"
    Effects_human = "Biophilia"
if x == "Vildvin(Parthenocissus)":
    Environmental_benefits = "Wind breaker", "Storm water service"
    Pollinators_Invited = "Honey bee", "Lepidoptera", "Song Birds"
    Effects_human = "Biophilia"
 
print Environmental_benefits
print Effects_human
print Pollinators_Invited
# ---------- end python_6 ----------

area_2 = Area()  # -> Area, Centroid
ma_3 = MassAddition(Input=flatten(area_2.Area))  # -> Result, PartialResults

cset = CreateSet(List=python_6.Effects_human)  # -> Set, Map
cset_2 = CreateSet(List=python_6.Environmental_benefits)  # -> Set, Map
cset_3 = CreateSet(List=python_6.Pollinators_Invited)  # -> Set, Map

environment = Panel(cset_2.Set)
pollinators = Panel(cset_3.Set)
human_effects = Panel(cset.Set)

values = ValueListener(SomeProperty=True)  # -> Values, Indices

hideshow = HideShowObjectPreview(Visible=show_8, AllObjects_Object=[preview_4, legend_3])
hideshow_2 = HideShowObjectPreview(Visible=show_9, AllObjects_Object=[legend_2, preview])

hideshow_3 = HideShowObjectPreview(Visible=Toggle(False), AllObjects_Object=custom_preview_lineweights_7)

hideshow_4 = HideShowObjectPreview(Visible=show_5, AllObjects_Object=custom_preview_lineweights_16)
hideshow_5 = HideShowObjectPreview(Visible=show_7, AllObjects_Object=[conmesh_2, conmesh])
hideshow_6 = HideShowObjectPreview(Visible=show_2, AllObjects_Object=custom_preview_lineweights_15)
hideshow_7 = HideShowObjectPreview(
    Visible=show_3,
    AllObjects_Object=[custom_preview_lineweights_3, custom_preview_lineweights_12, custom_preview_lineweights_10, custom_preview_lineweights_11])
hideshow_8 = HideShowObjectPreview(Visible=show_9, AllObjects_Object=legend_2)
hideshow_9 = HideShowObjectPreview(Visible=show_8, AllObjects_Object=[preview_4, legend_3])
hideshow_10 = HideShowObjectPreview(Visible=show, AllObjects_Object=[screentext_4, screentext_5])
hideshow_11 = HideShowObjectPreview(Visible=show_6, AllObjects_Object=custom_preview_lineweights_6)
hideshow_12 = HideShowObjectPreview(AllObjects_Object=[custom_preview_lineweights_8, custom_preview_lineweights_9, custom_preview_lineweights])
hideshow_13 = HideShowObjectPreview(Visible=show_4, AllObjects_Object=[previewlw, previewlw_2])
hideshow_14 = HideShowObjectPreview(AllObjects_Object=[conmesh_2, crv_3, screentext, screentext_2, screentext_3, preview_4, conmesh])

hideshow_15 = HideShowObjectPreview(Visible=toggle_3, AllObjects_Object=[custom_preview_lineweights_8, custom_preview_lineweights_9])
hideshow_16 = HideShowObjectPreview(Visible=toggle_2, AllObjects_Object=preview_3)

path = FilePath("C:\MUTIA OLFACTORY\THESIS\experiment\DNK_Copenhagen.061800_IWEC.epw")
importloc = LBImportLocation(epw_file=path)  # -> location; plug-in component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

python_7 = GhPythonScript(x=show_5)  # -> out, a; same code as python

multiplication = Multiplication(A=value_list_21, B=value_list_22, C=value_list_23, D=value_list_2)
division = Division(A=multiplication, B=10000)

crv = Curve(<curve referenced from the Rhino model>)
boundary = BoundarySurfaces(Edges=crv)
ivist = IsoVist(Count=10, Radius=100)  # -> Points, Distance, Index

# ----
# GREEN ROOF EXTENSIVE
trim = TrimWithRegion()  # -> Inside, Outside
boundary_2 = BoundarySurfaces(Edges=trim.Outside)
custom_preview_lineweights = CustomPreviewLineweights(Geometry=boundary_2, Shader=ColourSwatch(SwatchColor=RGB(97, 210, 0)), Absolute=False)

Z = UnitZ(Factor=distance)
X = UnitX(Factor=Slider(-800, range=-800..0))
X_2 = UnitX(Factor=Slider(-800, range=-800..0))
Z_2 = UnitZ(Factor=Slider(1, range=0..10))
addition_2 = Addition(A=distance, B=Slider(0.5, range=0..1))
swatch = ColourSwatch(SwatchColor=RGB(101, 156, 70))
series = Series(Start=0, Step=addition_2, Count=how_many)
panel_5 = Panel("""High 
Medium 
Low """)
Z_3 = UnitZ(Factor=series)

multiplication_2 = Multiplication(B=value_list_9, C=value_list_3, D=value_list_2)
division_2 = Division(A=multiplication_2, B=10000)

rec = Rectangle({Plane=PlaneXY(213.5, 291.5, 0), Size=Domain2(u=-7.5..7.5, v=-81.5..81.5)})
legend = Legend(
    Colour=[ColourSwatch(SwatchColor=RGB(37, 122, 0)), ColourSwatch(SwatchColor=RGB(255, 255, 0)), ColourSwatch(SwatchColor=RGB(255, 20, 0))],
    Tags=panel_5,
    Rectangle=rec,
    LegendType=101)

# ----
# EXISTING TREES?
# CONDITION
# STRATEGY
value_list_32 = ValueList({"RØN (Sorbus Hybrida": "RØN (Sorbus Hybrida)", "RUBINIA (Robinia pseudoacacia)", "PLATAN (Plantear)", "ELM (Ulmus glabra)", "BETULA PENDULA", "KIRSBÆR (Ceresia)"}, selected=[])
canopy_wide_2 = Slider(0, range=0..10)
how_many_trees = Slider(0, range=0..50)
value_list_33 = ValueList({"LOCAL STRATEGY": 1,15, "ECOLOGICALY DESIRABLE BUT NOT LOCAL": 1,1, "NOT BOTH OF LOCAL AND ECOLOGICAL": 1, "()": 0}, selected="()")
value_list_34 = ValueList({"GOOD": 3, "MODERATE": 2, "POOR": 1, "()": 0}, selected="()")

python_8 = GhPythonScript(Tree_choice=value_list_32)  # -> flatten(Pollinators_Invited), flatten(Environmental_benefits), flatten(Effects_human)
# ---------- python_8: Python ----------
import rhinoscriptsyntax as rs
if Tree_choice == "RØN (Sorbus Hybrida)":
    Environmental_benefits = "Wind breaker", "Storm water service"
    Effects_human = "Allergies", "Biophilia", "Shading"
    Pollinators_Invited = "Song Birds"
if Tree_choice == "RUBINIA (Robinia pseudoacacia)":
    Environmental_benefits = "Wind breaker", "Storm water service"
    Effects_human = "Allergies", "Biophilia", "Shading"
    Pollinators_Invited = "Honey bee", "Lepidoptera", "Song Birds"
if Tree_choice == "PLATAN (Plantear)":
    Environmental_benefits = "Wind breaker", "Storm water service"
    Effects_human = "Allergies", "Biophilia", "Shading"
    Pollinators_Invited = "Hoverfly", "Song Birds"
if Tree_choice == "BETULA PENDULA":
    Environmental_benefits = "Wind breaker", "Storm water service"
    Effects_human = "Allergies", "Biophilia", "Shading"
    Pollinators_Invited = "Hoverfly", "Song Birds"

 
print Environmental_benefits
print Effects_human
print Pollinators_Invited
# ---------- end python_8 ----------
cset_4 = CreateSet(List=[python_8.Effects_human, python_3.b])  # -> Set, Map
cset_5 = CreateSet(List=[python_8.Environmental_benefits, python_3.a])  # -> Set, Map
cset_6 = CreateSet(List=python_8.Pollinators_Invited)  # -> Set, Map
mindex = MemberIndex(Set=python_8.Pollinators_Invited, Member=cset_6.Set)  # -> Index, Count
mindex_2 = MemberIndex(Set=[python_8.Effects_human, python_3.b], Member=cset_4.Set)  # -> Index, Count
mindex_3 = MemberIndex(Set=[python_8.Environmental_benefits, python_3.a], Member=cset_5.Set)  # -> Index, Count

# ----
# YEAR ESTIMATION
# CREATED
# DETAILS
# (BEFORE)
panel_6 = Panel(cset_6.Set)
panel_7 = Panel(cset_4.Set)
panel_8 = Panel(cset_5.Set)

chart = CreateChart(Data=mindex_3.Count, Names=panel_8, Title=panel_3, SubTitle="(BEFORE)", ChartType=1)
chart_2 = CreateChart(Data=mindex.Count, Names=panel_6, Title=panel_4, SubTitle="(BEFORE)", ChartType=0)
chart_3 = CreateChart(Data=mindex_2.Count, Names=panel_7, Title="EFFECTS", SubTitle="(BEFORE)", ChartType=1)

multiplication_3 = Multiplication(A=canopy_wide_2, B=how_many_trees)
multiplication_4 = Multiplication(A=multiplication_3, B=value_list_34, C=value_list_33)
division_3 = Division(A=multiplication_4, B=10000)

area_3 = Panel(multiplication_3)
habitat_unit = Panel(division_3)

# ----
# HABEETAT
# SITE
# LOCATION
# COPENHAGEN,
# lat:55.63,
# lon:12.67,
# tz:1.0,
# elev:5.00
area_plot_neighborhoof = Curve(<curve referenced from the Rhino model>)

crv_2 = Curve(area_plot_neighborhoof)

boundary_3 = BoundarySurfaces(Edges=crv_2)
divide = DivideDomain²(Domain=boundary_3, UCount=Slider(35, range=0..100), VCount=Slider(35, range=0..100))  # -> flatten(Segments)
subsrf = Isotrim(Surface=flatten(boundary_3), Domain=divide)  # -> flatten(Surface)
debrep = DeconstructBrep(Brep=subsrf)  # -> Faces, Edges, Vertices
area_4 = Area(Geometry=debrep.Faces)  # -> Area, Centroid

boundary_4 = BoundarySurfaces(Edges=crv_2)
divide_2 = DivideDomain²(Domain=boundary_4, UCount=Slider(41, range=0..100), VCount=Slider(41, range=0..100))  # -> flatten(Segments)
subsrf_2 = Isotrim(Surface=flatten(boundary_4), Domain=divide_2)  # -> flatten(Surface)
debrep_2 = DeconstructBrep(Brep=subsrf_2)  # -> Faces, Edges, Vertices
area_5 = Area(Geometry=debrep_2.Faces)  # -> Area, Centroid

Z_4 = UnitZ(Factor=[Slider(15, range=0..100), Slider(2, range=0..10), Slider(100, range=0..100)])
extr = Extrude(Base=area_plot_neighborhoof, Direction=Z_4)
debrep_3 = DeconstructBrep(Brep=extr)  # -> Faces, Edges, Vertices
sdivide = DivideSurface(Surface=debrep_3.Faces, UCount=Slider(1, range=0..10), VCount=10)  # -> Points, Normals, Parameters
pline = PolyLine(Vertices=sdivide.Points, Closed=False)
dash = DashPattern(Curve=pline, Pattern=sdivide.Normals)  # -> Dashes, Gaps
item = ListItem(List=extr, Index=0, Wrap=True)  # -> flatten(Item)
crv_3 = Curve(dash.Dashes)
item_2 = ListItem(List=extr, Index=Slider(1, range=0..100), Wrap=True)  # -> flatten(Item)
item_3 = ListItem(List=extr, Index=Slider(2, range=0..10), Wrap=True)  # -> flatten(Item)
number_slider_6 = Slider(8, range=0..10)
pop3d = Populate3D(Region=item, Count=Slider(1, range=0..1), Seed=crv_3)
pop3d_2 = Populate3D(Region=item_3, Count=Slider(1, range=0..1), Seed=crv_3)
pop3d_3 = Populate3D(Region=item_2, Count=Slider(1, range=0..1), Seed=crv_3)

screentext = ScreenOrientedText(Text="BUTTERFLY, HOVERFLY", Justification=7, Location=pop3d, SizeFactor=Slider(8, range=0..10), Depth=0, Absolute=False)
screentext_2 = ScreenOrientedText(Text="DRAGONFLY, BUGS, ANTS", Justification=7, Location=pop3d_3, SizeFactor=number_slider_6, Depth=0, Absolute=False)
screentext_3 = ScreenOrientedText(Text="SONG BIRD'", Justification=7, Location=pop3d_2, SizeFactor=number_slider_6, Depth=0, Absolute=False)

# ----
# SITE FRAMING
# HEDGE
N = Slider(0, range=-30..0)
# CREATE CLUSTER
layer_1 = Slider(7, range=0..15)
layer_3 = Slider(2, range=0..10)
layer_2 = Slider(4, range=0..10)

offset = OffsetCurve(Curve=area_plot_neighborhoof, Distance=N, Corners=1)
loft = Loft(
    Curves=flatten([area_plot_neighborhoof, offset]),
    Options={Adjust=False, Closed=False, LoftEnds=0, LoftSimp=0, LoftType=0, Rebuild=10, Refit=0.01})
boundary_5 = BoundarySurfaces(Edges=offset)
area_6 = Area(Geometry=loft)  # -> Area, Centroid

# ----
# 2
area_7 = Panel(area_6.Area)

multiplication_5 = Multiplication(A=area_7, B=value_list_4, C=value_list_5, D=value_list_6)
division_4 = Division(A=multiplication_5, B=10000)

# ----
# HABITAT CREATION
# HEDGE
panel_9 = Panel(division_4)

equalareagreedy = CSharpScript(pl=offset, n=layer_1)  # -> out, A; inputs pl: Polyline, n: Int32
# ---------- equalareagreedy: C# ----------
   /**
   * Polygon Splitting by Area developed by Martin Dennemark at Bauhaus University Weimar, DecodingSpaces & Form Follows You
   * Greatly based on Gediminas Rimša polyline split algorithm
   * https://github.com/grimsa/polysplit
   * which is derived from Sumit Khetarpal http://www.khetarpal.org/polygon-splitting/
   * Licensed under the MIT license.
   */
  
  
    if(!pl.IsClosed || !pl.IsValid){
      Print("Polyline is not valid");
    }
    if(n < 2){
      Print("Number of parts should be greater than 1!");
    }
    AreaMassProperties amp = AreaMassProperties.Compute(pl.ToNurbsCurve());
    double singlePartArea = amp.Area / (double) n;
    List<Polyline> polylineParts = new List<Polyline>();
    Polyline remainingPoly = pl;
    for(int i = 0; i < n - 1; i++){
      remainingPoly = split(remainingPoly, polylineParts, singlePartArea);
    }
    polylineParts.Add(remainingPoly);
    A = polylineParts;
# ---------- equalareagreedy: C# additional code ----------
  public Polyline split(Polyline polyline, List<Polyline> resultList, double singlePartArea){
    List<Line> segments = polyline.GetSegments().ToList();
    List<Cut> possibleCuts = new List<Cut>();
    AreaMassProperties amp = AreaMassProperties.Compute(polyline.ToNurbsCurve());

    for(int i = 0; i < segments.Count() - 2; i++){
      for(int j = i + 2; j < segments.Count();j++){
        int segmentsCovered = j - i + 1;
        if(segments.Count() == segmentsCovered){
          break;
        }
        Line edgeA = segments[i];
        Line edgeB = segments[j];

        EdgePair edgePair = new EdgePair(edgeA, edgeB);
        EdgePairSubpolylines subpolyline = edgePair.getSubpolylines();
        List<Cut> cutForCurrentEdgePair = subpolyline.getCuts(polyline, singlePartArea);
        possibleCuts.AddRange(cutForCurrentEdgePair);
      }
    }

    if(possibleCuts.Count > 0){
      Cut shortestCut = possibleCuts.Aggregate((minItem, nextItem) => minItem.getLength() < nextItem.getLength() ? minItem : nextItem);
      resultList.Add(shortestCut.getCutAway());

      return shortestCut.getCutRemain();}
    else return polyline;
  }
  public class Cut{
    private double length;
    private Polyline cutAway;
    private Polyline cutRemain;

    public Cut(double lengthOfCut, Polyline cutAway, Polyline cutRemain){
      this.length = lengthOfCut;
      this.cutAway = cutAway;
      this.cutRemain = cutRemain;
    }

    public double getLength(){
      return length;
    }
    public Polyline getCutAway(){
      return cutAway;
    }
    public Polyline getCutRemain(){
      return cutRemain;
    }

  }

 /**
 * Represents a pair of edges on polygon's exterior ring.
 * Warning: direction of edges is assumed to be the same as in the polygon's exterior ring.
 *
 * Possible lines of cut are located in one of:
 *
 * T1 - First triangle, may not exist in some cases
 * Trapezoid - Trapezoid, always present
 * T2 - Second triangle, may not exist in some cases
 *
 *
 *                                edgeA
 *            edgeA.p0 .____________________________. edgeA.p1
 *                    /|                            |\
 *                   /                                \
 *   outsideEdge2   /  |                            |  \   outsideEdge1
 *                 /                                    \
 *                / T2 |        Trapezoid           | T1 \
 *               /                                        \
 *              .______.____________________________|______.
 *        edgeB.p1                edgeB                    edgeB.p0
 *                     ^                            ^
 *                 projected1                  projected0
 *
 */

  class EdgePair{

    private Line edgeA;
    private Line edgeB;

    private Point3d projected0;
    private Point3d projected1;

    public EdgePair(Line edgeA, Line edgeB){

      double ia, ib;
      Point3d interesectionPoint = new Point3d(double.MaxValue, double.MaxValue, double.MaxValue);
      if(Rhino.Geometry.Intersect.Intersection.LineLine(edgeA, edgeB, out ia, out ib))
        interesectionPoint = edgeA.PointAt(ia);
      bool intersectionOnEdge = false;
      if(ia >= 0 && ia <= 1) intersectionOnEdge = true;
      if(ib >= 0 && ib <= 1) intersectionOnEdge = true;

      this.edgeA = edgeA;
      this.edgeB = edgeB;

      projected0 = getProjectedPoint(edgeA.To, edgeB, interesectionPoint, intersectionOnEdge);
      if(projected0.X == double.MaxValue){
        projected0 = getProjectedPoint(edgeB.From, edgeA, interesectionPoint, intersectionOnEdge);
      }

      projected1 = getProjectedPoint(edgeB.To, edgeA, interesectionPoint, intersectionOnEdge);

      if(projected1.X == double.MaxValue){
        projected1 = getProjectedPoint(edgeA.From, edgeB, interesectionPoint, intersectionOnEdge);
      }
    }
    public EdgePairSubpolylines getSubpolylines() {
      return new EdgePairSubpolylines(edgeA, edgeB, projected0, projected1);
    }


    private Point3d getProjectedPoint(Point3d point, Line opposingEdge, Point3d intPt, bool intersectionOnEdge){
      if(intPt.X != double.MaxValue){
        if(intersectionOnEdge){
          Vector3d vecPerpendicular = Vector3d.CrossProduct(opposingEdge.UnitTangent, Vector3d.ZAxis);
          Line perpendicularLine = new Line(intPt, vecPerpendicular);
          int orientationIndexOfPoint = OrientationOfPoint(perpendicularLine, point);
          double p = opposingEdge.ClosestParameter(intPt);
          if(p >= 0 && p <= 1){
            int orientationIndexOfStart = OrientationOfPoint(perpendicularLine, opposingEdge.From);

            if (orientationIndexOfPoint == orientationIndexOfStart) {
              // Start of opposingEdge is on the same side as the vertex (thus we shorten the segment discarding p1)
              opposingEdge = new Line(opposingEdge.From, intPt);

            } else {
              // End of opposingEdge is on the same side as the vertex (thus we shorten the segment discarding p0)
              opposingEdge = new Line(intPt, opposingEdge.To);
            }
          }
          else {
            // the intersection point is outside of the edge
            int orientationIndexOfEdge = OrientationOfPoint(perpendicularLine, opposingEdge.To);   // -1 or +1

            // TODO: need to handle edge pairs better
            //                    boolean vertexIsOnPerpendicularLine = orientationIndexOfVertex == 0;             // this is needed to handle cases when both edges are perpendicular to each other
            bool vertexIsOnPerpendicularLine = false;
            if (!vertexIsOnPerpendicularLine && orientationIndexOfPoint != orientationIndexOfEdge) {
              // projection of vertex is located somewhere on the opposite side of the intersection point (not on the edge)
              return new Point3d(double.MaxValue, double.MaxValue, double.MaxValue);

            }
            // otherwise it is on the same side - proceed as usual
          }
        }
        double distanceOfPoint = point.DistanceTo(intPt);


        double distOfOpEdgePoint1 = intPt.DistanceTo(opposingEdge.From);
        double distOfOpEdgePoint2 = intPt.DistanceTo(opposingEdge.To);
        if(distanceOfPoint >= Math.Max(distOfOpEdgePoint1, distOfOpEdgePoint2) || distanceOfPoint <= Math.Min(distOfOpEdgePoint1, distOfOpEdgePoint2))
        {
          return new Point3d(double.MaxValue, double.MaxValue, double.MaxValue);
        }

        Point3d furtherPoint = getFurtherEnd(intPt, opposingEdge);
        Line extendedOpposingEdge = new Line(intPt, furtherPoint);
        return extendedOpposingEdge.PointAt(distanceOfPoint / extendedOpposingEdge.Length);
      } else {
        // In case of parallel lines, we do not have an intersection point
        double p = opposingEdge.ClosestParameter(point);       // a projection onto opposingEdge (extending to infinity)
        if(p >= 0 && p <= 1){
          return opposingEdge.PointAt(p);
        }else
        {
          return new Point3d(double.MaxValue, double.MaxValue, double.MaxValue);
        }

      }
    }
    private int OrientationOfPoint(Line line, Point3d point){
      Point3d testPt;
      Plane pl = new Plane(line.From, line.UnitTangent, Vector3d.ZAxis);
      pl.RemapToPlaneSpace(point, out testPt);
      if(testPt.Z < 0)
        return -1;
      else if (testPt.Z > 0) return 1;
      else return 0;

    }
    public Point3d getFurtherEnd(Point3d point, Line line)
    {
      return point.DistanceTo(line.From) > point.DistanceTo(line.To) ? line.From : line.To;
    }


  }


  class EdgePairSubpolylines {
    private Line edgeA;
    private Line edgeB;

    private Polyline triangle1;
    private Polyline trapezoid;
    private Polyline triangle2;
    private double triangle1Area = 0;
    private double trapezoidArea = 0;
    private double triangle2Area = 0;

    public EdgePairSubpolylines(Line edgeA, Line edgeB, Point3d projected0, Point3d projected1){
      this.edgeA = edgeA;
      this.edgeB = edgeB;
      if(projected0.X != double.MaxValue){
        List<Point3d> pts = new List<Point3d>();
        pts.Add(edgeA.To);
        pts.Add(projected0);
        pts.Add(edgeB.From);
        pts.Add(edgeA.To);
        triangle1Area = CalculateTriangleArea(pts[0], pts[1], pts[2]);
        triangle1 = new Polyline(pts);
      }
      if(projected1.X != double.MaxValue){
        List<Point3d> pts = new List<Point3d>();
        pts.Add(edgeA.From);
        pts.Add(projected1);
        pts.Add(edgeB.To);
        pts.Add(edgeA.From);
        triangle2Area = CalculateTriangleArea(pts[0], pts[1], pts[2]);
        triangle2 = new Polyline(pts);
      }
      List<Point3d> ptsTrapezoid = new List<Point3d>();

      double tolerance = 0.0001;
      if(projected1.DistanceTo(edgeA.ClosestPoint(projected1, true)) < tolerance &&
      projected1.X != double.MaxValue){ptsTrapezoid.Add(projected1); }
      else ptsTrapezoid.Add(edgeA.From);
      if(projected0.DistanceTo(edgeA.ClosestPoint(projected0, true)) < tolerance &&
        projected0.X != double.MaxValue) ptsTrapezoid.Add(projected0);
      else ptsTrapezoid.Add(edgeA.To);
      if(projected0.DistanceTo(edgeB.ClosestPoint(projected0, true)) < tolerance &&
        projected0.X != double.MaxValue) ptsTrapezoid.Add(projected0);
      else ptsTrapezoid.Add(edgeB.From);
      if(projected1.DistanceTo(edgeB.ClosestPoint(projected1, true)) < tolerance &&
        projected1.X != double.MaxValue) ptsTrapezoid.Add(projected1);
      else ptsTrapezoid.Add(edgeB.To);
      ptsTrapezoid.Add(ptsTrapezoid[0]);
      trapezoidArea = CalculateTriangleArea(ptsTrapezoid[0], ptsTrapezoid[1], ptsTrapezoid[2]);
      trapezoidArea += CalculateTriangleArea(ptsTrapezoid[0], ptsTrapezoid[3], ptsTrapezoid[2]);

      trapezoid = new Polyline(ptsTrapezoid);
    }
    public Polyline getTriangle1(){
      return triangle1;
    }
    public Polyline getTriangle2(){
      return triangle2;
    }
    public Polyline getTrapezoid(){
      return trapezoid;
    }
    public double getTotalArea(){
      return triangle1Area + triangle2Area + trapezoidArea;
    }

    /// <summary>
    ///
    /// </summary>
    /// <param name="polyline"></param>
    /// <param name="singlePartArea"></param>
    /// <returns></returns>
    public List<Cut> getCuts(Polyline polyline, double singlePartArea){
      List<Cut> cuts = new List<Cut>();
      List<Line> segments = polyline.GetSegments().ToList();
      int indexOfEdgeA = 0;
      int indexOfEdgeB = 0;
      for(int i = 0; i < segments.Count;i++){
        if(edgeA.PointAt(0.5).DistanceTo(segments[i].PointAt(0.5)) < 0.001){
          indexOfEdgeA = i;
        }
        else if(edgeB.PointAt(0.5).DistanceTo(segments[i].PointAt(0.5)) < 0.001){
          indexOfEdgeB = i;
        }
      }

      int segmentsCovered = indexOfEdgeB - indexOfEdgeA + 1;// number of segments covered by a LineRing starting with edgeA and ending with edgeB (including)
      // Polygon's exterior ring is equal to [edgeA + segmentsBetweenEdgePair + edgeB + segmentsOutsideEdgePair]
      int segmentCountBetweenEdgePair = segmentsCovered - 2;
      int segmentCountOutsideEdgePair = segments.Count - segmentsCovered;
      // if edges are not connected directly, polygon has extra area adjacent to them
      Polyline polylineOutside1 = new Polyline();
      Polyline polylineOutside2 = new Polyline();

      if (segmentCountBetweenEdgePair > 1) {
        // calculate extra area bounded by segmentsBetweenEdgePair
        for(int i = 0; i < segmentCountBetweenEdgePair + 1; i++){
          int ptIdx = indexOfEdgeA + 1 + i;
          if(ptIdx >= segments.Count) ptIdx -= segments.Count;
          polylineOutside1.Add(polyline[ptIdx]);
        }
        polylineOutside1.Add(polylineOutside1[0]);
      }
      if (segmentCountOutsideEdgePair > 1) {
        // calculate extra area bounded by segmentCountOutsideEdgePair
        for(int i = 0; i < segmentCountOutsideEdgePair + 1; i++){
          int ptIdx = indexOfEdgeB + 1 + i;
          if(ptIdx >= segments.Count) ptIdx -= segments.Count;
          polylineOutside2.Add(polyline[ptIdx]);

        }
        polylineOutside2.Add(polylineOutside2[0]);
      }
      double areaOutside1 = 0, areaOutside2 = 0;
      if(polylineOutside1 != null && polylineOutside1.IsValid && polylineOutside1.Length > 0.01){
        AreaMassProperties amp = AreaMassProperties.Compute(polylineOutside1.ToNurbsCurve());
        if(amp != null) areaOutside1 = amp.Area;
      }
      if(polylineOutside2 != null && polylineOutside2.IsValid && polylineOutside2.Length > 0.01){
        AreaMassProperties amp = AreaMassProperties.Compute(polylineOutside2.ToNurbsCurve());
        if(amp != null) areaOutside2 = amp.Area;
      }

      // check first direction (areaOutside1 + T1 + Trapezoid + T2)
      if(areaOutside1 <= singlePartArea){

        Line lineOfCut = new Line();
        if(areaOutside1 + triangle1Area > singlePartArea){
          double areaToCutAwayInTriangle = singlePartArea - areaOutside1;
          double fraction = areaToCutAwayInTriangle / triangle1Area;
          if(triangle1 != null){
            Point3d projected0 = triangle1[1];
            Line edgeWithPointOfCut = (edgeA.ClosestPoint(projected0, true).DistanceTo(projected0) < 0.000001) ? new Line(edgeA.To, projected0) : new Line(edgeB.From, projected0);
            Point3d pointOfCut = edgeWithPointOfCut.PointAt(fraction);
            lineOfCut = (edgeA.ClosestPoint(pointOfCut, true).DistanceTo(pointOfCut) < 0.000001) ? new Line(edgeB.From, pointOfCut) : new Line(pointOfCut, edgeA.To);
          }

        }else if(areaOutside1 + triangle1Area + trapezoidArea >= singlePartArea){

          Line trapezoidOnEdgeA = trapezoid.SegmentAt(0);
          Line trapezoidOnEdgeB = trapezoid.SegmentAt(2);
          trapezoidOnEdgeA.Flip();
          double areaToCutAway = singlePartArea - (areaOutside1 + triangle1Area);
          double fraction = areaToCutAway / trapezoidArea;

          double ia, ib;
          if(Rhino.Geometry.Intersect.Intersection.LineLine(trapezoidOnEdgeA, trapezoidOnEdgeB, out ia, out ib))
          {

            Point3d intersectionPoint = trapezoidOnEdgeA.PointAt(ia);
            double wholeDistance = intersectionPoint.DistanceTo(trapezoidOnEdgeA.From);
            double distTo = intersectionPoint.DistanceTo(trapezoidOnEdgeA.To);
            bool flip = true;
            if(distTo > wholeDistance){ wholeDistance = distTo; flip = false; fraction = 1 - fraction;}
            fraction = splitFractionTrapezoid(trapezoidOnEdgeA.Length, wholeDistance, trapezoidOnEdgeA.UnitTangent, fraction);
            if(!flip) fraction = 1 - fraction;
          }

          Point3d pointOfCutOnEdgeA = trapezoidOnEdgeA.PointAt(fraction);
          Point3d pointOfCutOnEdgeB = trapezoidOnEdgeB.PointAt(fraction);
          lineOfCut = new Line(pointOfCutOnEdgeB, pointOfCutOnEdgeA);


        }else if(areaOutside1 + getTotalArea() >= singlePartArea){

          double areaToCutAwayInTriangle = singlePartArea - (areaOutside1 + triangle1Area + trapezoidArea);
          double fraction = areaToCutAwayInTriangle / triangle2Area;
          if(triangle1 != null){
            Point3d projected1 = triangle2[1];
            Line edgeWithPointOfCut = (edgeA.ClosestPoint(projected1, true).DistanceTo(projected1) < 0.000001) ? new Line(projected1, edgeA.From) : new Line(projected1, edgeB.To);
            Point3d pointOfCut = edgeWithPointOfCut.PointAt(fraction);
            lineOfCut = (edgeA.ClosestPoint(pointOfCut, true).DistanceTo(pointOfCut) < 0.000001) ? new Line(edgeB.To, pointOfCut) : new Line(pointOfCut, edgeA.From);
          }
        }

        Rhino.Geometry.Intersect.CurveIntersections ci = Rhino.Geometry.Intersect.Intersection.CurveLine(polyline.ToNurbsCurve(), lineOfCut, 0.001, 0.001);
        int intCount = 0;
        foreach(Rhino.Geometry.Intersect.IntersectionEvent ie in ci) if(ie.IsPoint)intCount++;
        if(lineOfCut != null && intCount <= 2){

          PolylineCurve polyCurve = polyline.ToPolylineCurve();
          double t0, t1;
          polyCurve.ClosestPoint(lineOfCut.To, out t0);
          polyCurve.ClosestPoint(lineOfCut.From, out t1);

          if(t0 != t1){

            Curve cutAway = polyCurve.Trim(new Interval(t0, t1));
            if(cutAway != null){
              Polyline plCutAway = cutAway.ToPolyline(0.000001, 0.000001, 0.001, 1000000).ToPolyline();
              plCutAway.Add(plCutAway[0]);
              plCutAway.ReduceSegments(0.000001);

              Curve cutRemain = polyCurve.Trim(new Interval(t1, t0));
              Polyline plCutRemain = cutRemain.ToPolyline(0.000001, 0.000001, 0.001, 1000000).ToPolyline();
              plCutRemain.Add(plCutRemain[0]);
              plCutRemain.ReduceSegments(0.000001);
              cuts.Add(new Cut(lineOfCut.Length, plCutAway, plCutRemain));
            }
          }
        }
      }

      // check first direction (areaOutside1 + T1 + Trapezoid + T2)
      if(areaOutside2 <= singlePartArea){

        Line lineOfCut = new Line();
        if(areaOutside2 + triangle2Area > singlePartArea){
          double areaToCutAwayInTriangle = singlePartArea - areaOutside2;

          double fraction = areaToCutAwayInTriangle / triangle2Area;
          if(triangle2 != null){
            Point3d projected1 = triangle2[1];
            Line edgeWithPointOfCut = (edgeA.ClosestPoint(projected1, true).DistanceTo(projected1) < 0.000001) ? new Line(edgeA.From, projected1) : new Line(edgeB.To, projected1);
            Point3d pointOfCut = edgeWithPointOfCut.PointAt(fraction);
            lineOfCut = (edgeA.ClosestPoint(pointOfCut, true).DistanceTo(pointOfCut) < 0.000001) ? new Line(pointOfCut, edgeB.To) : new Line(edgeA.From, pointOfCut);
          }


        }else if(areaOutside2 + triangle2Area + trapezoidArea >= singlePartArea){

          Line trapezoidOnEdgeA = trapezoid.SegmentAt(0);
          Line trapezoidOnEdgeB = trapezoid.SegmentAt(2);
          trapezoidOnEdgeB.Flip();

          double areaToCutAway = singlePartArea - (areaOutside2 + triangle2Area);
          double fraction = areaToCutAway / trapezoidArea;
          double ia, ib;
          if(Rhino.Geometry.Intersect.Intersection.LineLine(trapezoidOnEdgeA, trapezoidOnEdgeB, out ia, out ib))
          {

            Point3d intersectionPoint = trapezoidOnEdgeA.PointAt(ia);
            double wholeDistance = intersectionPoint.DistanceTo(trapezoidOnEdgeA.From);
            double distTo = intersectionPoint.DistanceTo(trapezoidOnEdgeA.To);
            bool flip = true;
            if(distTo > wholeDistance){ wholeDistance = distTo; flip = false; fraction = 1 - fraction;}
            fraction = splitFractionTrapezoid(trapezoidOnEdgeA.Length, wholeDistance, trapezoidOnEdgeA.UnitTangent, fraction);
            if(!flip) fraction = 1 - fraction;
          }

          Point3d pointOfCutOnEdgeA = trapezoidOnEdgeA.PointAt(fraction);
          Point3d pointOfCutOnEdgeB = trapezoidOnEdgeB.PointAt(fraction);
          lineOfCut = new Line(pointOfCutOnEdgeA, pointOfCutOnEdgeB);

        }else if(areaOutside2 + getTotalArea() >= singlePartArea){

          double areaToCutAwayInTriangle = singlePartArea - (areaOutside2 + triangle2Area + trapezoidArea);
          double fraction = areaToCutAwayInTriangle / triangle1Area;
          if(triangle1 != null){
            Point3d projected0 = triangle1[1];
            Line edgeWithPointOfCut = (edgeA.ClosestPoint(projected0, true).DistanceTo(projected0) < 0.000001) ? new Line(projected0, edgeA.To) : new Line(projected0, edgeB.From);
            Point3d pointOfCut = edgeWithPointOfCut.PointAt(fraction);
            lineOfCut = (edgeA.ClosestPoint(pointOfCut, true).DistanceTo(pointOfCut) < 0.000001) ? new Line(pointOfCut, edgeB.From) : new Line(edgeA.To, pointOfCut);
          }
        }
        Rhino.Geometry.Intersect.CurveIntersections ci = Rhino.Geometry.Intersect.Intersection.CurveLine(polyline.ToNurbsCurve(), lineOfCut, 0.001, 0.001);
        int intCount = 0;
        foreach(Rhino.Geometry.Intersect.IntersectionEvent ie in ci) if(ie.IsPoint)intCount++;
        if(lineOfCut != null && intCount <= 2){
          PolylineCurve polyCurve = polyline.ToPolylineCurve();
          double t0, t1;
          polyCurve.ClosestPoint(lineOfCut.To, out t0);
          polyCurve.ClosestPoint(lineOfCut.From, out t1);

          if(t0 != t1){

            Curve cutAway = polyCurve.Trim(new Interval(t0, t1));
            if(cutAway != null){
              Polyline plCutAway = cutAway.ToPolyline(0.000001, 0.000001, 0.001, 1000000).ToPolyline();
              plCutAway.Add(plCutAway[0]);
              plCutAway.ReduceSegments(0.000001);
              Curve cutRemain = polyCurve.Trim(new Interval(t1, t0));
              Polyline plCutRemain = cutRemain.ToPolyline(0.000001, 0.000001, 0.001, 1000000).ToPolyline();
              plCutRemain.Add(plCutRemain[0]);
              plCutRemain.ReduceSegments(0.000001);
              cuts.Add(new Cut(lineOfCut.Length, plCutAway, plCutRemain));
            }
          }
        }
      }


      return cuts;


    }

    public double splitFractionTrapezoid(double distance, double wholeDistance, Vector3d dir, double fraction){
      dir.Unitize();
      double remainingDistance = wholeDistance - distance;
      Vector3d rotateVec = dir * remainingDistance;
      rotateVec.Rotate(Math.Acos(remainingDistance / wholeDistance), Vector3d.ZAxis);
      double projectedDistance = Math.Abs(Vector3d.Multiply(rotateVec, dir));
      double ankathete = wholeDistance - (fraction * (wholeDistance - projectedDistance));
      double gegenkathete = Math.Sqrt(Math.Pow(wholeDistance / 2.0, 2) - Math.Pow((wholeDistance / 2.0 - ankathete), 2));
      double hypothenuse = Math.Sqrt(Math.Pow(ankathete, 2) + Math.Pow((gegenkathete), 2));

      return (wholeDistance - hypothenuse) / distance;

    }
    private double CalculateTriangleArea(Point3d pt0, Point3d pt1, Point3d pt2){
      return Math.Abs(Vector3d.CrossProduct(new Vector3d(pt0 - pt2), new Vector3d(pt1 - pt2)).Length / 2);

    }
  }
# ---------- end equalareagreedy ----------

equalareagreedy_2 = CSharpScript(pl=equalareagreedy.A)  # -> out, A; inputs pl: Polyline, n: Int32; same code as equalareagreedy
trim_2 = TrimWithRegion(Curve=equalareagreedy_2.A, Region=area_plot_neighborhoof)  # -> Inside, Outside

equalareagreedy_3 = CSharpScript(pl=equalareagreedy.A, n=layer_2)  # -> out, A; inputs pl: Polyline, n: Int32; same code as equalareagreedy
equalareagreedy_4 = CSharpScript(pl=equalareagreedy_3.A, n=layer_3)  # -> out, A; inputs pl: Polyline, n: Int32; same code as equalareagreedy

trim_3 = TrimWithRegion(Curve=equalareagreedy_4.A, Region=area_plot_neighborhoof)  # -> Inside, Outside
boundary_6 = BoundarySurfaces(Edges=trim_3.Inside)

area_8 = Area(Geometry=boundary_6)  # -> Area, Centroid
ma_4 = MassAddition(Input=flatten(area_8.Area))  # -> Result, PartialResults
panel_10 = Panel(ma_4.Result)

area_9 = Area(Geometry=boundary_5)  # -> Area, Centroid
subtraction = Subtraction(A=area_9.Area, B=panel_10)

equalareagreedy_5 = CSharpScript(pl=equalareagreedy_4.A)  # -> out, A; inputs pl: Polyline, n: Int32; same code as equalareagreedy

equalareagreedy_6 = CSharpScript(pl=equalareagreedy_5.A, n=number_slider_2)  # -> out, A; inputs pl: Polyline, n: Int32; same code as equalareagreedy
item_4 = ListItem(List=equalareagreedy_6.A, Index=number_slider, Wrap=True)
trim_4 = TrimWithRegions(Curve=equalareagreedy_6.A, Regions=item_4)  # -> Inside, Outside

width_path = Slider(5, range=0..10)
custom_preview_lineweights_2 = CustomPreviewLineweights(
    Geometry=[trim_2.Inside, equalareagreedy_3.A, equalareagreedy_4.A],
    Shader=ColourSwatch(SwatchColor=RGB(171, 175, 162)),
    Thickness=width_path,
    Absolute=False)

equalareagreedy_7 = CSharpScript(pl=trim_4.Outside, n=number_slider_3)  # -> out, A; inputs pl: Polyline, n: Int32; same code as equalareagreedy
cull_i = CullIndex(List=equalareagreedy_7.A, Indices=number_slider_4, Wrap=True)
trim_5 = TrimWithRegions(Curve=equalareagreedy_7.A, Regions=cull_i)  # -> Inside, Outside

offset_2 = OffsetCurve(Curve=item_4, Distance=Slider(0, range=-5..0), Corners=1)

equalareagreedy_8 = CSharpScript(pl=equalareagreedy_7.A, n=Slider(4, range=0..10))  # -> out, A; inputs pl: Polyline, n: Int32; same code as equalareagreedy
item_5 = ListItem(List=equalareagreedy_8.A, Index=Slider(4, range=0..10), Wrap=True)
trim_6 = TrimWithRegion(Curve=equalareagreedy_8.A, Region=item_5)  # -> Inside, Outside
boundary_7 = BoundarySurfaces(Edges=item_5)

# ---- group: BAREGROUND
boundary_8 = BoundarySurfaces(Edges=trim_6.Outside)
custom_preview_lineweights_3 = CustomPreviewLineweights(Geometry=boundary_8, Shader=ColourSwatch(SwatchColor=RGB(160, 183, 37)), Absolute=False)

# ----
geo = Geometry(boundary_8)

number_slider_7 = Slider(9, range=0..100)
geo_2 = Geometry(boundary_8)
mshadow = MeshShadow(Mesh=geo_2, Light=Vector(0, 0, -1), Plane=PlaneXY(0, 0, 0))
number_slider_8 = Slider(70, range=0..100)
ivist_2 = IsoVist(Plane=area_4.Centroid, Count=number_slider_7, Radius=number_slider_8, Obstacles=flatten(mshadow))  # -> Points, Distance, Index
ma_5 = MassAddition(Input=ivist_2.Distance)  # -> reverse(Result), PartialResults
division_5 = Division(A=ma_5.Result, B=number_slider_7)  # -> reverse(Result)
remap = RemapNumbers(Value=division_5, Source=number_slider_8, Target=Domain(0, 1))  # -> Mapped, Clipped

mshadow_2 = MeshShadow(Mesh=geo, Light=Vector(0, 0, -1), Plane=PlaneXY(0, 0, 0))

# ---- group: WILDERNESS AREA
custom_preview_lineweights_4 = CustomPreviewLineweights(Geometry=boundary_5, Shader=ColourSwatch(SwatchColor=RGB(0, 109, 29)), Absolute=False)

# ---- group: URBAN TREE
custom_preview_lineweights_5 = CustomPreviewLineweights(Geometry=loft, Shader=ColourSwatch(SwatchColor=RGB(84, 177, 99)), Absolute=False)

# ----
equalareagreedy_9 = CSharpScript(pl=trim_6.Outside, n=Slider(2, range=0..10))  # -> out, A; inputs pl: Polyline, n: Int32; same code as equalareagreedy
item_6 = ListItem(List=equalareagreedy_9.A, Index=Slider(4, range=0..10), Wrap=True)

area_10 = Area(Geometry=flatten(boundary_7))  # -> flatten(Area), Centroid
ma_6 = MassAddition(Input=area_10.Area)  # -> Result, PartialResults
area_11 = Panel(ma_6.Result)
gradient = Gradient(
    LowerLimit=0,
    UpperLimit=1,
    Parameter=remap.Mapped,
    stops=[0: RGB(255, 255, 192), 0.168: RGB(255, 255, 128), 0.512: RGB(144, 238, 144), 0.802: RGB(64, 224, 208), 1: RGB(0, 191, 255)])
preview = CustomPreview(Geometry=subsrf, Material=flatten(gradient))

number_slider_9 = Slider(19, range=0..50)
area_12 = Area(Geometry=equalareagreedy_3.A, UseTasks=True)  # -> Area, Centroid
swatch_2 = ColourSwatch(SwatchColor=RGB(0, 0, 0))
screentext_4 = ScreenOrientedText(
    Text=area_12.Area,
    Justification=7,
    Location=area_12.Centroid,
    SizeFactor=number_slider_9,
    Color=swatch_2,
    Depth=0,
    Absolute=False)

area_13 = Area(Geometry=area_plot_neighborhoof)  # -> Area, Centroid
screentext_5 = ScreenOrientedText(
    Text=area_13.Area,
    Justification=7,
    Location=area_13.Centroid,
    SizeFactor=number_slider_9,
    Color=swatch_2,
    Depth=0,
    Absolute=False)

# ----
# Input your site geometry, location
# and information here
# 1
panel_11 = Panel(area_13.Area)

multiplication_6 = Multiplication(A=panel_11, B=flatten(ma.Result), C=value_list_3, D=value_list_2)
division_6 = Division(A=flatten(multiplication_6), B=10000)

addition_3 = Addition(A=flatten(division_6), B=habitat_unit)

# ----
# BASE
panel_12 = Panel(addition_3)

area_14 = Area(Geometry=[equalareagreedy.A, equalareagreedy_3.A])  # -> Area, Centroid
screentext_6 = ScreenOrientedText(
    Text=area_14.Area,
    Justification=7,
    Location=area_14.Centroid,
    SizeFactor=Slider(15, range=0..100),
    Depth=0,
    Absolute=False)

# ----
# BUILDING PLOTTING
value_list_35 = ValueList({"BAREGROUND/PARK": 2, "VEGETATED GARDEN": 2, "RAIN GARDEN": 2, "DEVELOPED LAND/SEALED SURFACE": 0, "BUILT LINEAR FEATURE": 0}, selected="DEVELOPED LAND/SEALED SURFACE")

# ----
# TREES LANDSCAPE
how_many_trees_2 = Slider(1, range=0..10)

# ----
# LAYERS OF GREEN  PATCHES
# GREEN AREA LAYOUT
number_slider_10 = Slider(2, range=0..10)

equalareagreedy_10 = CSharpScript(pl=[trim_5.Inside, cull_i], n=number_slider_10)  # -> out, A; inputs pl: Polyline, n: Int32; same code as equalareagreedy
item_7 = ListItem(List=equalareagreedy_10.A, Index=Slider(32, range=0..100), Wrap=True)
trim_7 = TrimWithRegions(Curve=equalareagreedy_10.A, Regions=item_7)  # -> Inside, Outside

# ----
# TYPE 1
# Base type
# TYPE 2
# Base type
# GREEN ROOF
value_list_36 = ValueList({"BAREGROUND/PARK": 2, "VEGETATED GARDEN": 2, "RAIN GARDEN": 2, "DEVELOPED LAND/SEALED SURFACE": 0, "BUILT LINEAR FEATURE": 0}, selected="DEVELOPED LAND/SEALED SURFACE")
value_list_37 = ValueList({"BAREGROUND/PARK": 2, "VEGETATED GARDEN": 2, "RAIN GARDEN": 2, "DEVELOPED LAND/SEALED SURFACE": 0, "BUILT LINEAR FEATURE": 0}, selected="DEVELOPED LAND/SEALED SURFACE")
height = Slider(30, range=0..32)
height_2 = Panel(height)
# BUILDING FEATURE
# CONFIGURATION
number_slider_11 = Slider(2, range=0..10)
height_3 = Slider(50, range=0..100)
height_4 = Panel(height_3)

equalareagreedy_11 = CSharpScript(pl=offset_2, n=number_slider_11)  # -> out, A; inputs pl: Polyline, n: Int32; same code as equalareagreedy
item_8 = ListItem(List=equalareagreedy_11.A, Index=Slider(10, range=0..10), Wrap=True)
trim_8 = TrimWithRegion(Curve=equalareagreedy_11.A, Region=item_8)  # -> Inside, Outside
boundary_9 = BoundarySurfaces(Edges=item_8)
boundary_10 = BoundarySurfaces(Edges=trim_8.Outside)
boundary_11 = BoundarySurfaces(Edges=item_8)
crv_4 = Curve(trim_8.Outside)

# ---- group: type 2
Z_5 = UnitZ(Factor=height)
extr_2 = Extrude(Base=trim_8.Outside, Direction=Z_5)

# ---- group: type 1
Z_6 = UnitZ(Factor=height_3)
extr_3 = Extrude(Base=item_8, Direction=Z_6)

# ----
brep = Brep(extr_3)
brep_2 = Brep(extr_2)

# ----
# BUILDING FACADE
swatch_3 = ColourSwatch(SwatchColor=RGB(171, 183, 182))
custom_preview_lineweights_6 = CustomPreviewLineweights(Geometry=[brep, brep_2], Shader=swatch_3, Absolute=False)

move = Move(Geometry=crv_4, Motion=Z)  # -> Geometry, Transform
boundary_12 = BoundarySurfaces(Edges=item_8)

boundary_13 = BoundarySurfaces(Edges=trim_8.Outside)
area_15 = Area(Geometry=boundary_12)  # -> flatten(Area), Centroid
area_16 = Area(Geometry=boundary_13)  # -> flatten(Area), Centroid

area_17 = Panel(area_16.Area)
area_18 = Panel(area_15.Area)

# ----
# CALCULATOR
mm = MassMultiplication(Input=[area_17, area_18])  # -> Result, PartialResults

building_area = Panel(mm.Result)

# ----
# TRADING SUMMARY HABITATS
area_created = Panel(building_area)

subtraction_2 = Subtraction(A=panel_10, B=building_area)

item_9 = ListItem(List=boundary_12, Index=Slider(17, range=0..100), Wrap=True)

area_19 = Area(Geometry=item_9)  # -> Area, Centroid
ma_7 = MassAddition(Input=flatten(area_19.Area))  # -> Result, PartialResults

move_2 = Move(Geometry=boundary_10, Motion=Z_5)  # -> Geometry, Transform
move_3 = Move(Geometry=boundary_11, Motion=Z_6)  # -> Geometry, Transform

custom_preview_lineweights_7 = CustomPreviewLineweights(Geometry=[move_2.Geometry, move_3.Geometry], Shader=ColourSwatch(SwatchColor=RGB(171, 183, 182)), Absolute=False)

offset_3 = OffsetCurve(Curve=move.Geometry, Distance=width, Corners=1)
pshift = ShiftPaths(Data=offset_3, Offset=-1)

debrep_4 = DeconstructBrep(Brep=extr_2)  # -> Faces, Edges, Vertices
item_10 = ListItem(List=debrep_4.Faces, Index=building_type_2, Wrap=True)
equalareagreedy_12 = CSharpScript(pl=item_10, n=Slider(3, range=0..10))  # -> out, A; inputs pl: Polyline, n: Int32; same code as equalareagreedy
number_slider_12 = Slider(2, range=0..10)
Y = UnitY(Factor=Slider(-0.5, range=-1..-0.5))
boundary_14 = BoundarySurfaces(Edges=equalareagreedy_12.A)
extr_4 = Extrude(Base=boundary_14, Direction=Y)
previewlw = CustomPreviewLineweights(Geometry=extr_4, Shader=ColourSwatch(SwatchColor=RGB(72, 136, 43)), Absolute=False)

boundary_15 = BoundarySurfaces(Edges=trim_8.Outside)
boundary_16 = BoundarySurfaces(Edges=item_8)
Z_7 = UnitZ(Factor=height)
Z_8 = UnitZ(Factor=height_3)
move_4 = Move(Geometry=boundary_15, Motion=Z_7)  # -> Geometry, Transform
move_5 = Move(Geometry=boundary_16, Motion=Z_8)  # -> Geometry, Transform

equalareagreedy_13 = CSharpScript(pl=move_5.Geometry, n=number_slider_5)  # -> out, A; inputs pl: Polyline, n: Int32; same code as equalareagreedy
equalareagreedy_14 = CSharpScript(pl=move_4.Geometry, n=number_slider_5)  # -> out, A; inputs pl: Polyline, n: Int32; same code as equalareagreedy
item_11 = ListItem(List=equalareagreedy_13.A, Index=Slider(5, range=0..10), Wrap=True)
item_12 = ListItem(List=equalareagreedy_14.A, Index=Slider(5, range=0..10), Wrap=True)
trim_9 = TrimWithRegion(Curve=equalareagreedy_14.A, Region=item_12)  # -> Inside, Outside
trim_10 = TrimWithRegion(Curve=equalareagreedy_13.A, Region=item_11)  # -> Inside, Outside

# ----
# INTENSIVE GREENROOF
boundary_17 = BoundarySurfaces(Edges=[trim_9.Outside, trim_10.Outside])
custom_preview_lineweights_8 = CustomPreviewLineweights(Geometry=boundary_17, Shader=ColourSwatch(SwatchColor=RGB(179, 214, 149)), Absolute=False)

# ----
# BIODIVERSE GREEN ROOF
boundary_18 = BoundarySurfaces(Edges=[item_12, item_11])
custom_preview_lineweights_9 = CustomPreviewLineweights(Geometry=boundary_18, Shader=ColourSwatch(SwatchColor=RGB(74, 90, 0)), Absolute=False)

area_20 = Area(Geometry=boundary_18)  # -> flatten(Area), Centroid
item_13 = ListItem(List=area_20.Area, Index=Slider(0, range=0..100), Wrap=True)
ma_8 = MassAddition(Input=area_20.Area)  # -> Result, PartialResults

panel_13 = Panel(ma_8.Result)
panel_14 = Panel(item_13)

multiplication_7 = Multiplication(A=panel_13, B=value_list_21, C=value_list_22, D=value_list_23)
division_7 = Division(A=multiplication_7, B=10000)

area_21 = Area(Geometry=boundary_17)  # -> flatten(Area), Centroid
panel_15 = Panel(area_21.Area)
item_14 = ListItem(List=panel_15, Index=Slider(0, range=0..100), Wrap=True)
ma_9 = MassAddition(Input=panel_15)  # -> Result, PartialResults

total = Panel(ma_9.Result)
area_gf = Panel(item_14)

multiplication_8 = Multiplication(A=total, B=value_list_27, C=value_list_28, D=value_list_29)
division_8 = Division(A=multiplication_8, B=10000)

loft_2 = Loft(
    Curves=[pshift, move.Geometry],
    Options={Adjust=False, Closed=False, LoftEnds=0, LoftSimp=0, LoftType=0, Rebuild=10, Refit=0.01})

debrep_5 = DeconstructBrep(Brep=extr_3)  # -> Faces, Edges, Vertices
item_15 = ListItem(List=debrep_5.Faces, Index=building_type_1, Wrap=True)
equalareagreedy_15 = CSharpScript(pl=item_15, n=Slider(3, range=0..10))  # -> out, A; inputs pl: Polyline, n: Int32; same code as equalareagreedy
number_slider_13 = Slider(2, range=0..10)
# AREA SIZE TAG
Y_2 = UnitY(Factor=Slider(0.2, range=-1..1))
boundary_19 = BoundarySurfaces(Edges=equalareagreedy_15.A)
extr_5 = Extrude(Base=boundary_19, Direction=Y_2)
previewlw_2 = CustomPreviewLineweights(Geometry=extr_5, Shader=ColourSwatch(SwatchColor=RGB(72, 136, 43)), Absolute=False)

area_22 = Area(Geometry=loft_2)  # -> flatten(Area), Centroid
extr_6 = Extrude(Base=loft_2, Direction=Z_2)
ma_10 = MassAddition(Input=area_22.Area)  # -> Result, PartialResults
total_area = Panel(ma_10.Result)
multiplication_9 = Multiplication(A=total_area, B=how_many)
brep_3 = Brep(extr_6)
move_6 = Move(Geometry=brep_3, Motion=Z_3)  # -> Geometry, Transform

multiplication_10 = Multiplication(A=building_area, B=value_list_35, C=value_list_3, D=value_list_2)
division_9 = Division(A=multiplication_10, B=10000)

preview_2 = CustomPreview(Geometry=move_6.Geometry, Material=swatch)

addition_4 = Addition(A=division_2, B=division_9)

area_23 = Area(Geometry=boundary_14)  # -> flatten(Area), Centroid
area_24 = Area(Geometry=boundary_19)  # -> flatten(Area), Centroid

crv_5 = Curve(item_8)
Z_9 = UnitZ(Factor=distance_2)
move_7 = Move(Geometry=crv_5, Motion=Z_9)  # -> Geometry, Transform
offset_4 = OffsetCurve(Curve=move_7.Geometry, Distance=width_2, Corners=1)
pshift_2 = ShiftPaths(Data=offset_4, Offset=-1)
loft_3 = Loft(
    Curves=[pshift_2, move_7.Geometry],
    Options={Adjust=False, Closed=False, LoftEnds=0, LoftSimp=0, LoftType=0, Rebuild=10, Refit=0.01})
Z_10 = UnitZ(Factor=Slider(1, range=0..1))
extr_7 = Extrude(Base=loft_3, Direction=Z_10)
addition_5 = Addition(A=distance_2, B=Slider(0.5, range=0..1))
brep_4 = Brep(extr_7)
series_2 = Series(Start=0, Step=addition_5, Count=how_many_2)
area_25 = Area(Geometry=loft_3)  # -> flatten(Area), Centroid
Z_11 = UnitZ(Factor=series_2)
move_8 = Move(Geometry=brep_4, Motion=Z_11)  # -> Geometry, Transform
multiplication_11 = Multiplication(A=area_25.Area, B=how_many_2)
ma_11 = MassAddition(Input=multiplication_11)  # -> Result, PartialResults
preview_3 = CustomPreview(Geometry=move_8.Geometry, Material=swatch)

ma_12 = MassAddition(Input=area_23.Area)  # -> Result, PartialResults
ma_13 = MassAddition(Input=area_24.Area)  # -> Result, PartialResults

panel_16 = Panel(ma_12.Result)
panel_17 = Panel(ma_13.Result)
addition_6 = Addition(A=panel_16, B=panel_17)

python_9 = GhPythonScript(x=value_list_25)  # -> out, a, b
# ---------- python_9: Python ----------
import rhinoscriptsyntax as rs
if x == "GOOD":
    a = 3
    b = 5
elif x == "MODERATE":
    a = 2
    b = 3
elif x == "POOR":
    a = 1
    b = 1

print a
print b
# ---------- end python_9 ----------
python_10 = GhPythonScript(x=show_4, y=addition_6)  # -> out, a
# ---------- python_10: Python ----------
__author__ = "LENOVO-PC"
__version__ = "2023.05.16"

import rhinoscriptsyntax as rs
if x == False:
    a = "0"
elif x == True:
    a = y

print a
# ---------- end python_10 ----------

area_26 = Panel(python_10.a)

multiplication_12 = Multiplication(Area=area_26, Habitat=value_list_24, Condition=python_9.a, Strategy=value_list_26)
division_10 = Division(A=multiplication_12, B=10000)

habitat_unit_2 = Panel(division_10)
year_estimation = Panel(python_9.b)

area_27 = Area(Geometry=boundary_12, UseTasks=True)  # -> Area, Centroid
screentext_7 = ScreenOrientedText(
    Text=area_27.Area,
    Justification=7,
    Location=area_27.Centroid,
    SizeFactor=Slider(10, range=0..10),
    Color=ColourSwatch(SwatchColor=RGB(0, 0, 0)),
    Depth=0,
    Absolute=False)

# ----
# CONDITION
# STRATEGY
how_many_trees_3 = Slider(1, range=0..10)
canopy_wide_3 = Slider(2, range=0..10)
value_list_38 = ValueList({"LOCAL STRATEGY": 1,15, "ECOLOGICALY DESIRABLE BUT NOT LOCAL": 1,1, "NOT BOTH OF LOCAL AND ECOLOGICAL": 1, "()": 0}, selected="ECOLOGICALY DESIRABLE BUT NOT LOCAL")
value_list_39 = ValueList({"GOOD": 3, "MODERATE": 2, "POOR": 1, "()": 0}, selected="MODERATE")

python_11 = GhPythonScript(x=[value_list_39, value_list_17])  # -> out, a
# ---------- python_11: Python ----------
__author__ = "LENOVO-PC"
__version__ = "2023.05.16"

import rhinoscriptsyntax as rs
if x == 3:
    a = 30
elif x == 2:
    a = 27
elif x == 1:
    a = 10
else :
    a = 0

print a
# ---------- end python_11 ----------
year = Panel([python_11.a, python_9.b, python_4.a])

cset_7 = CreateSet(List=habitat)  # -> Set, Map
cset_8 = CreateSet(List=year)  # -> Set, Map
panel_18 = Panel(cset_7.Set)
panel_19 = Panel(cset_8.Set)
chart_4 = CreateChart(Data=panel_19, Names=panel_18, Title="TARGET YEAR", ChartType=1)

area_28 = Area(Geometry=boundary_18)  # -> Area, Centroid
listdexs = ListIndices(List=flatten(area_28.Centroid))
mindex_4 = MemberIndex(Set=listdexs, Member=listdexs)  # -> Index, Count
ma_14 = MassAddition(Input=mindex_4.Count)  # -> Result, PartialResults
panel_20 = Panel(ma_14.Result)
multiplication_13 = Multiplication(A=how_many_trees_3, B=panel_20)

amount_tree = Panel(multiplication_13)

multiplication_14 = Multiplication(A=amount_tree, B=how_many_trees_2)
multiplication_15 = Multiplication(A=multiplication_14, B=value_list_39, C=value_list_38)
division_11 = Division(A=multiplication_15, B=10000)

multiplication_16 = Multiplication(A=amount_tree, B=canopy_wide_3)
multiplication_17 = Multiplication(A=multiplication_16, B=value_list_39, C=value_list_38, D=python_7.a)
division_12 = Division(A=multiplication_17, B=10000)

value_list_40 = ValueList({"RØN (Sorbus Hybrida": "RØN (Sorbus Hybrida)", "RUBINIA (Robinia pseudoacacia)", "PLATAN (Plantear)", "ELM (Ulmus glabra)", "BETULA PENDULA", "KIRSBÆR (Ceresia)"}, selected=["RUBINIA (Robinia pseudoacacia)", "KIRSBÆR (Ceresia)"])
habitat_unit_3 = Panel(division_12)

# ----
# INDIVIDUAL TREES
panel_21 = Panel([habitat_unit_3, division_11])

python_12 = GhPythonScript(Tree_choice=value_list_40)  # -> flatten(Pollinators_Invited), flatten(Environmental_benefits), flatten(Effects_human)
# ---------- python_12: Python ----------
import rhinoscriptsyntax as rs
if Tree_choice == "RØN (Sorbus Hybrida)":
    Environmental_benefits = "Wind breaker", "Storm water service"
    Effects_human = "Allergies", "Biophilia", "Shading"
    Pollinators_Invited = "Song Birds"
if Tree_choice == "RUBINIA (Robinia pseudoacacia)":
    Environmental_benefits = "Wind breaker", "Storm water service"
    Effects_human = "Allergies", "Biophilia", "Shading"
    Pollinators_Invited = "Honey bee", "Lepidoptera", "Song Birds"
if Tree_choice == "PLATAN (Plantear)":
    Environmental_benefits = "Wind breaker", "Storm water service"
    Effects_human = "Allergies", "Biophilia", "Shading"
    Pollinators_Invited = "Hoverfly", "Song Birds"
if Tree_choice == "BETULA PENDULA":
    Environmental_benefits = "Wind breaker", "Storm water service"
    Effects_human = "Allergies", "Biophilia", "Shading"
    Pollinators_Invited = "Hoverfly", "Song Birds"
if Tree_choice == "KIRSBÆR (Ceresia)":
    Pollinators_Invited = "Honey bee", "Solitary bee", "Song Birds"
    Effects_human = "Biophilia", "Shading", 

 
print Environmental_benefits
print Effects_human
print Pollinators_Invited
# ---------- end python_12 ----------
cset_9 = CreateSet(List=python_12.Environmental_benefits)  # -> Set, Map
cset_10 = CreateSet(List=python_12.Pollinators_Invited)  # -> Set, Map
cset_11 = CreateSet(List=python_12.Effects_human)  # -> Set, Map

environment_2 = Panel(cset_9.Set)
human_effects_2 = Panel(cset_11.Set)
pollinators_2 = Panel(cset_10.Set)

# ----
# DETAILS
# (AFTER)
panel_22 = Panel([python_2.Pollinators_invited, pollinators_2, pollinators])
panel_23 = Panel([python_2.Effects_human, human_effects_2, human_effects, function])
panel_24 = Panel([environment, environment_2])

mindex_5 = MemberIndex(Set=panel_24, Member=panel_24)  # -> Index, Count
chart_5 = CreateChart(Data=mindex_5.Count, Names=panel_24, Title=panel_2, SubTitle="(AFTER)", ChartType=1)

cset_12 = CreateSet(List=[panel_22, pollinators])  # -> Set, Map
mindex_6 = MemberIndex(Set=panel_22, Member=cset_12.Set)  # -> Index, Count
panel_25 = Panel(cset_12.Set)

cset_13 = CreateSet(List=panel_23)  # -> Set, Map
panel_26 = Panel(cset_13.Set)
mindex_7 = MemberIndex(Set=panel_23, Member=cset_13.Set)  # -> Index, Count

stack = CreateStack(UIElements=[chart, chart_5], Horizontal=True)

area_type1 = Panel(ma_11.Result)

area_type_2 = Panel(multiplication_9)

ma_15 = MassAddition(Input=[area_type_2, area_type1])  # -> flatten(Result), PartialResults

python_13 = GhPythonScript(x=flatten([toggle, toggle_2]))  # -> out, a
# ---------- python_13: Python ----------
__author__ = "LENOVO-PC"
__version__ = "2023.05.18"

import rhinoscriptsyntax as rs
if x == True:
    a = 2
else:
    a = 0
print a
# ---------- end python_13 ----------
hideshow_17 = HideShowObjectPreview(Visible=toggle, AllObjects_Object=preview_2)
multiplication_18 = Multiplication(A=ma_15.Result, B=python_13.a, C=addition)
division_13 = Division(A=multiplication_18, B=10000)  # -> flatten(Result)

ma_16 = MassAddition(Input=division_13)  # -> flatten(Result), PartialResults

habitat_unit_4 = Panel(ma_16.Result)

addition_7 = Addition(A=division_8, B=[division_7, habitat_unit_4], C=habitat_unit_2)

ma_17 = MassAddition(Input=addition_7)  # -> Result, PartialResults

# ----
# BUILDING
panel_27 = Panel(ma_17.Result)

panel_28 = Panel("""POLLINATORS 
INVITED """)
chart_6 = CreateChart(Data=mindex_7.Count, Names=panel_26, Title="EFFECTS", SubTitle="(AFTER)", ChartType=1)
chart_7 = CreateChart(Data=mindex_6.Count, Names=panel_25, Title=panel_28, SubTitle="(AFTER)", ChartType=0)

stack_2 = CreateStack(UIElements=[chart_2, chart_7], Horizontal=True)
stack_3 = CreateStack(UIElements=[chart_3, chart_6], Horizontal=True)

panel_29 = Panel("""HABITAT TARGET
HABITAT CREATION""")
launchwin = LaunchWindow(
    Show=toggle_4,
    Name="Control Window",
    Width=370,
    Height=Slider(250, range=0..1000),
    ChildStatus=0,
    EnableHorizScroll=False)

area_29 = Area(Geometry=boundary_8)  # -> Area, Centroid

# ---- group: LANDSCAPE
multiplication_19 = Multiplication(A=area_11, B=value_list_12, C=value_list_11, D=value_list_10)
division_14 = Division(A=multiplication_19, B=10000)

# ----
habitat_unit_5 = Panel(division_14)

# ----
# LANDSCAPE
boundary_20 = BoundarySurfaces(Edges=item_6)
boundary_21 = BoundarySurfaces(Edges=[trim_7.Outside, item_5])
trim_11 = TrimWithRegion(Curve=boundary_21, Region=boundary_20)  # -> Inside, Outside

area_30 = Area(Geometry=boundary_21)  # -> Area, Centroid
ma_18 = MassAddition(Input=flatten(area_30.Area))  # -> Result, PartialResults

multiplication_20 = Multiplication(A=area_7, B=value_list_4, C=boundary_20, D=value_list_6)
division_15 = Division(A=multiplication_20, B=10000)

area_31 = Area(Geometry=boundary_20)  # -> Area, Centroid
ma_19 = MassAddition(Input=flatten(area_31.Area))  # -> flatten(Result), PartialResults
subtraction_3 = Subtraction(A=area_29.Area, B=area_31.Area)  # -> flatten(Result)
ma_20 = MassAddition(Input=subtraction_3)  # -> flatten(Result), flatten(PartialResults)

area_32 = Panel(ma_19.Result)

panel_30 = Panel(ma_20.Result)
item_16 = ListItem(List=panel_30, Index=Slider(0, range=0..100), Wrap=True)

area_33 = Panel(item_16)

custom_preview_lineweights_10 = CustomPreviewLineweights(Geometry=boundary_20, Shader=ColourSwatch(SwatchColor=RGB(0, 109, 29)), Thickness=boundary_20, Absolute=False)

custom_preview_lineweights_11 = CustomPreviewLineweights(Geometry=[trim_11.Outside, boundary_7], Shader=ColourSwatch(SwatchColor=RGB(212, 232, 155)), Absolute=False)

number_slider_14 = Slider(8, range=0..100)
geo_3 = Geometry(boundary_20)
mshadow_3 = MeshShadow(Mesh=[geo_3, boundary], Light=Vector(0, 0, -1), Plane=PlaneXY(0, 0, 0))
number_slider_15 = Slider(55, range=0..100)
ivist_3 = IsoVist(Plane=area_5.Centroid, Count=number_slider_14, Radius=number_slider_15, Obstacles=flatten(mshadow_3))  # -> Points, Distance, Index
ma_21 = MassAddition(Input=ivist_3.Distance)  # -> reverse(Result), PartialResults
division_16 = Division(A=ma_21.Result, B=number_slider_14)  # -> reverse(Result)
remap_2 = RemapNumbers(Value=division_16, Source=number_slider_15, Target=Domain(0, 1))  # -> Mapped, Clipped

# ----
# public spaces
gradient_2 = Gradient(
    LowerLimit=0,
    UpperLimit=1,
    Parameter=remap_2.Mapped,
    stops=[0.2: RGB(46, 139, 87), 0.595: RGB(154, 205, 50), 0.805: RGB(255, 215, 0), 1: RGB(255, 255, 255), 1: RGB(255, 255, 192), 1: RGB(255, 255, 255)])
panel_31 = Panel("""Very High (0-5)
High (6-12)
Medium (13-19)
Low (>19)""")
panel_32 = Panel("""Very High (0-5)
High (6-12)
Medium (13-19)
Low (>19)""")
rec_2 = Rectangle({Plane=PlaneXY(213.5, 291.5, 0), Size=Domain2(u=-7.5..7.5, v=-81.5..81.5)})
rec_3 = Rectangle({Plane=PlaneXY(213.5, 291.5, 0), Size=Domain2(u=-7.5..7.5, v=-81.5..81.5)})

move_9 = Move(Geometry=rec_2, Motion=X)  # -> Geometry, Transform
move_10 = Move(Geometry=rec_3, Motion=X_2)  # -> Geometry, Transform

# ----
# ECOLOGICAL CONNECTIVITY
preview_4 = CustomPreview(Geometry=subsrf_2, Material=flatten(gradient_2))

legend_2 = Legend(
    Colour=[ColourSwatch(SwatchColor=RGB(255, 255, 192)), ColourSwatch(SwatchColor=RGB(255, 255, 130)), ColourSwatch(SwatchColor=RGB(148, 239, 143)), ColourSwatch(SwatchColor=RGB(1, 156, 206))],
    Tags=panel_32,
    Rectangle=move_9.Geometry,
    LegendType=101)

legend_3 = Legend(
    Colour=[ColourSwatch(SwatchColor=RGB(38, 114, 71)), ColourSwatch(SwatchColor=RGB(144, 199, 53)), ColourSwatch(SwatchColor=RGB(253, 215, 1)), ColourSwatch(SwatchColor=RGB(255, 249, 159))],
    Tags=panel_31,
    Rectangle=move_10.Geometry,
    LegendType=101)

# ---- group: LANDSCAPE (continued)
multiplication_21 = Multiplication(A=area_32, B=value_list_8, C=value_list_7)
multiplication_22 = Multiplication(A=area_33, B=value_list_14, C=value_list_13)
division_17 = Division(A=multiplication_21, B=10000)
division_18 = Division(A=multiplication_22, B=10000)

# ----
habitat_unit_garden = Panel(division_18)

habitat_unit_6 = Panel(division_17)

number_slider_16 = Slider(4, range=0..10)

swatch_4 = ColourSwatch(SwatchColor=RGB(255, 255, 255))
custom_preview_lineweights_12 = CustomPreviewLineweights(Geometry=boundary_13, Shader=swatch_4, Thickness=number_slider_16, Absolute=False)

custom_preview_lineweights_13 = CustomPreviewLineweights(Geometry=boundary_9, Shader=swatch_4, Thickness=number_slider_16, Absolute=False)

# ---- group: HIGHWAY
number_slider_17 = Slider(0, range=0..10)
# Use this features if you do urban planning.
# This will provide urban trees area and wilderness (woodland, etc) in large scale
colour_swatch = ColourSwatch(SwatchColor=RGB(171, 175, 162))

# ----
# CODES
offset_5 = OffsetCurve(Curve=area_plot_neighborhoof, Distance=number_slider_17, Corners=1)
loft_4 = Loft(
    Curves=flatten([offset_5, area_plot_neighborhoof]),
    Options={Adjust=False, Closed=False, LoftEnds=0, LoftSimp=0, LoftType=0, Rebuild=10, Refit=0.01})

# ---- group: HIGHWAY (continued)
custom_preview_lineweights_14 = CustomPreviewLineweights(Geometry=loft_4, Shader=colour_swatch, Absolute=False)

# ----
# Building visualisation
mjoin = MeshJoin(Meshes=brep_2)
demesh = DeconstructMesh(Mesh=mjoin)  # -> Vertices, Faces, Colours, Normals
pdecon = Deconstruct(Point=demesh.Vertices)  # -> XComponent, YComponent, ZComponent
sort = SortList(Keys=pdecon.ZComponent, ValuesA=demesh.Vertices)  # -> flatten(Keys), flatten(ValuesA)
item_17 = ListItem(List=sort.Keys, Index=0, Wrap=True)
panel_33 = Panel(pdecon.ZComponent)
panel_34 = Panel(item_17)

merge = Merge(Data1=series, Data2=panel_34)  # -> flatten(Result)

positions_type_2 = Panel(merge)

gradient_3 = Gradient(
    LowerLimit=positions_type_2,
    UpperLimit=Slider(50, range=0..100),
    Parameter=panel_33,
    stops=[0: RGB(0, 128, 0), 0.429: RGB(255, 255, 0), 0.963: RGB(255, 0, 0)])

conmesh = ConstructMesh(Vertices=demesh.Vertices, Faces=demesh.Faces, Colours=gradient_3)

# ----
# Building visualisation
mjoin_2 = MeshJoin(Meshes=brep)
demesh_2 = DeconstructMesh(Mesh=mjoin_2)  # -> Vertices, Faces, Colours, Normals
pdecon_2 = Deconstruct(Point=demesh_2.Vertices)  # -> XComponent, YComponent, ZComponent
sort_2 = SortList(Keys=pdecon_2.ZComponent, ValuesA=demesh_2.Vertices)  # -> flatten(Keys), flatten(ValuesA)
item_18 = ListItem(List=sort_2.Keys, Index=0, Wrap=True)
panel_35 = Panel(item_18)
panel_36 = Panel(pdecon_2.ZComponent)

merge_2 = Merge(Data1=series_2, Data2=panel_35)  # -> flatten(Result)

positions_type_1 = Panel(merge_2)

gradient_4 = Gradient(
    LowerLimit=positions_type_1,
    UpperLimit=Slider(50, range=0..100),
    Parameter=panel_36,
    stops=[0: RGB(0, 128, 0), 0.503: RGB(255, 255, 0), 0.963: RGB(255, 0, 0)])

conmesh_2 = ConstructMesh(Vertices=demesh_2.Vertices, Faces=demesh_2.Faces, Colours=gradient_4)

# ----
# TREES LANSCAPE
number_slider_18 = Slider(0.3, range=0..1)
pop2d = Populate2D(Region=boundary_21, Count=how_many_trees_2, Seed=1)
sph = Sphere(Base=pop2d, Radius=canopy_wide)
cyl = Cylinder(Base=pop2d, Radius=number_slider_18, Length=Slider(10, range=0..10))

listdexs_2 = ListIndices(List=flatten(pop2d))
mindex_8 = MemberIndex(Set=listdexs_2, Member=listdexs_2)  # -> Index, Count
ma_22 = MassAddition(Input=mindex_8.Count)  # -> Result, PartialResults
multiplication_23 = Multiplication(A=how_many_trees_2, B=ma_22.Result)

total_amount = Panel(multiplication_23)

# ----
# Calculated with final time to target multiplier and the difficulties of multiplier (Biodiversity Net-Gain 4. 2023)
multiplication_24 = Multiplication(A=total_amount, B=value_list_17, C=value_list_18, D=canopy_wide, E=python.a)

division_19 = Division(A=multiplication_24, B=10000)
habitat_unit_7 = Panel(division_19)

# ---- group: LANDSCAPE (continued)
ma_23 = MassAddition(Input=[habitat_unit_7, habitat_unit_garden, habitat_unit_6, habitat_unit_5])  # -> Result, PartialResults

# ----
# LANDSCAPE
panel_37 = Panel(ma_23.Result)

ma_24 = MassAddition(Input=[panel_21, panel_37, panel_27, panel_9])  # -> Result, PartialResults

# ----
# HABITAT UNIT
panel_38 = Panel(ma_24.Result)

panel_39 = Panel([panel_12, panel_38])
chart_8 = CreateChart(Data=panel_39, Names=panel_29, Title="HABITAT UNIT", ChartType=1)

stack_4 = CreateStack(UIElements=[chart_8, chart_4], Horizontal=True)

addelems = AddElements(Window=launchwin, Elements=flatten([stack_4, stack_2, stack_3, stack]), DoVLChecking=True)  # -> AddedElements, ElementNames

# ----
# TREES GREENROOF
number_slider_19 = Slider(0.3, range=0..1)
pop2d_2 = Populate2D(Region=boundary_18, Count=how_many_trees_3, Seed=1)
cyl_2 = Cylinder(Base=pop2d_2, Radius=number_slider_19, Length=Slider(3, range=0..10))

# ----
# COLORS
number_slider_20 = Slider(10, range=0..10)
sph_2 = Sphere(Base=pop2d_2, Radius=Slider(3, range=0..10))

Z_12 = UnitZ(Factor=number_slider_20)
move_11 = Move(Geometry=sph, Motion=Z_12)  # -> Geometry, Transform
brep_5 = Brep([move_11.Geometry, cyl])

Z_13 = UnitZ(Factor=Slider(6, range=0..10))
move_12 = Move(Geometry=sph_2, Motion=Z_13)  # -> Geometry, Transform
brep_6 = Brep([move_12.Geometry, cyl_2])

custom_preview_lineweights_15 = CustomPreviewLineweights(Geometry=brep_5, Shader=ColourSwatch(SwatchColor=RGB(77, 208, 85)), Absolute=False)
custom_preview_lineweights_16 = CustomPreviewLineweights(Geometry=brep_6, Shader=ColourSwatch(SwatchColor=RGB(165, 241, 182)), Absolute=False)
